# Grasshopper definition Ch01_Python Basic Syntax_Part1.gh (Grasshopper 1.0.7)

# ---- group: End of Statements
python = GhPythonScript()  # -> out, message
# ---------- python: Python ----------
__author__ = "J. Chung"
__version__ = "2022.03.19"

import rhinoscriptsyntax as rs

message = 'Hello World!'
# ---------- end python ----------
python_2 = GhPythonScript()  # -> out, message
# ---------- python_2: Python ----------
__author__ = "J. Chung"
__version__ = "2022.03.19"

import rhinoscriptsyntax as rs

message\
=\
'This\
back slash\
acts \
like \
enter'
# ---------- end python_2 ----------
python_3 = GhPythonScript()  # -> out, message
# ---------- python_3: Python ----------
__author__ = "J. Chung"
__version__ = "2022.03.19"

import rhinoscriptsyntax as rs

message\
=\
'''triple
quotes
will
span
multiple lines
without
errors'''
# ---------- end python_3 ----------
python_4 = GhPythonScript()  # -> out, message
# ---------- python_4: Python ----------
__author__ = "J. Chung"
__version__ = "2022.03.19"

import rhinoscriptsyntax as rs

y = 3
x = 5
print(x+y)
# ---------- end python_4 ----------
python_5 = GhPythonScript()  # -> out, message
# ---------- python_5: Python ----------
__author__ = "J. Chung"
__version__ = "2022.03.19"

import rhinoscriptsyntax as rs

y = 3; x = 5; print(x+y)
# ---------- end python_5 ----------
panel = Panel(python.message)
panel_2 = Panel(python_4.out)
panel_3 = Panel(python_2.message)
panel_4 = Panel(python_3.message)
panel_5 = Panel(python_5.out)

# ---- group: Why GH-Python?
# GH-Python: 1_Python Basic Syntax_Part1
# Author: J. Chung
# Email: studio.jchung@gmail.com
x = Slider(60, range=0..100)
y = Slider(74, range=0..100)
z = Slider(72, range=0..100)
multiplication = Multiplication(A=x, B=y)
python_6 = GhPythonScript(x=x, y=y, z=z)  # -> out, output
# ---------- python_6: Python ----------
__author__ = "J. Chung"
__version__ = "2022.03.19"

import rhinoscriptsyntax as rs


output = - (x * y - z)
# ---------- end python_6 ----------
subtraction = Subtraction(A=multiplication, B=z)
neg = Negative(Value=subtraction)
panel_6 = Panel(python_6.output)
panel_7 = Panel(neg)

# ---- group: Import Modules
python_7 = GhPythonScript()  # -> out
# ---------- python_7: Python ----------
__author__ = "J. Chung"
__version__ = "2022.03.19"

import time

print (time.strftime("%H:%M:%S"))
# ---------- end python_7 ----------
python_8 = GhPythonScript()  # -> out, pt
# ---------- python_8: Python ----------
__author__ = "J. Chung"
__version__ = "2022.03.19"

import rhinoscriptsyntax as rs

pt = rs.AddPoint (1, 2, 3)
# ---------- end python_8 ----------
panel_8 = Panel(python_7)
panel_9 = Panel(python_8.pt)

# ---- group: User-Defined Function
python_9 = GhPythonScript(temp=Slider(50, range=0..100))  # -> out, cDegrees
# ---------- python_9: Python ----------
__author__ = "J. Chung"
__version__ = "2022.03.19"

import rhinoscriptsyntax as rs

def Celsius(fDegrees):
    _Celsius = (fDegrees - 32) * 5 / 9
    return _Celsius;
    
print "The temperature is ", Celsius(temp), " degrees C."
# ---------- end python_9 ----------
panel_10 = Panel(python_9.out)
