# Grasshopper definition Ch01_Python Basic Syntax_Part2.gh (Grasshopper 1.0.7)

# ---- group: Declaration
# GH-Python: 1_Python Basic Syntax_Part2
# Author: J. Chung
# Email: studio.jchung@gmail.com
python = GhPythonScript()  # -> out
# ---------- python: Python ----------
__author__ = "J. Chung"
__version__ = "2022.03.19"

number = 10
string = "This is a string"

print number
print string
# ---------- end python ----------
python_2 = GhPythonScript()  # -> out
# ---------- python_2: Python ----------
__author__ = "J. Chung"
__version__ = "2022.03.19"

a = True
b = False

print a
print b
# ---------- end python_2 ----------
python_3 = GhPythonScript()  # -> out
# ---------- python_3: Python ----------
__author__ = "J. Chung"
__version__ = "2022.03.19"

a, b = True, False

print a
print b
# ---------- end python_3 ----------
python_4 = GhPythonScript()  # -> out
# ---------- python_4: Python ----------
__author__ = "user"
__version__ = "2022.03.19"

global_var = True

def function1():
    local_var = False
    print global_var
    print local_var

function1() 
print global_var
print local_var
# ---------- end python_4 ----------
python_5 = GhPythonScript()  # -> out
# ---------- python_5: Python ----------
__author__ = "J. Chung"
__version__ = "2022.03.19"

g_var = 'True'
def function2():
    g_var = 'False'
    print 'inside the function var is ', g_var

function2()
print 'outside the function var is ', g_var
# ---------- end python_5 ----------
python_6 = GhPythonScript()  # -> out
# ---------- python_6: Python ----------
__author__ = "J. Chung"
__version__ = "2022.03.19"

g_var = "Global"
def function3():
    g_var = "Local"
    print 'inside the function var is ', g_var
    return;

function3()
print 'outside the function var is ', g_var
# ---------- end python_6 ----------
python_7 = GhPythonScript()  # -> out
# ---------- python_7: Python ----------
__author__ = "J. Chung"
__version__ = "2022.03.19"

a = 200
b = c = d = 1
e, f, g = 1, 2, "john"
h = 1
i = 2
j = "john"

print a
print b
print c
print d
print e
print f
print g
print h
print i
print j
# ---------- end python_7 ----------
python_8 = GhPythonScript()  # -> out
# ---------- python_8: Python ----------
__author__ = "J. Chung"
__version__ = "2022.03.19"

A = [ ] 
B = [1, 23, 45, 67] 
C = [2, 4, 'john'] 

print A
print B
print C
# ---------- end python_8 ----------
panel = Panel(python)
panel_2 = Panel(python_4)
panel_3 = Panel(python_5)
panel_4 = Panel(python_6)
panel_5 = Panel(python_2)
panel_6 = Panel(python_3)
panel_7 = Panel(python_7)
panel_8 = Panel(python_8)

python_9 = GhPythonScript()  # -> out
# ---------- python_9: Python ----------
__author__ = "J. Chung"
__version__ = "2022.03.19"

message = "Good morning"
num = 85
pi = 3.14159

print(type(message)) 
print(type(num)) 
print(type(pi))
# ---------- end python_9 ----------
python_10 = GhPythonScript()  # -> out
# ---------- python_10: Python ----------
__author__ = "J. Chung"
__version__ = "2022.03.19"

firstName = 'john'
lastName = "smith"
message = """This is a string that will span across multiple lines. Using newline characters
and no spaces for the next lines. The end of lines within this string also count as a newline when printed"""

print firstName
print lastName
print message
# ---------- end python_10 ----------
python_11 = GhPythonScript()  # -> out
# ---------- python_11: Python ----------
__author__ = "J. Chung"
__version__ = "2022.03.19"

var1 = 'Hello World!'
var2 = 'RhinoPython'

print var1[0] 
print var2[1:5]
# ---------- end python_11 ----------
python_12 = GhPythonScript()  # -> out
# ---------- python_12: Python ----------
__author__ = "J. Chung"
__version__ = "2022.03.19"

element = "a"
count = 5

print "The item {} is repeated {} times".format(element,count)
# ---------- end python_12 ----------
python_13 = GhPythonScript()  # -> out
# ---------- python_13: Python ----------
__author__ = "J. Chung"
__version__ = "2022.03.19"

mylist = ['Rhino', 'Grasshopper', 'Flamingo', 'Bongo']
 
print len(mylist)
print mylist[1]
print mylist[0:2]
# ---------- end python_13 ----------
python_14 = GhPythonScript()  # -> out
# ---------- python_14: Python ----------
__author__ = "J. Chung"
__version__ = "2022.03.19"

mylist = [0, 1, 2, 3]
mylist[0] = 'Rhino'
mylist[1] = 'Grasshopper'
mylist[2] = 'Flamingo'
mylist[3] = 'Bongo'
print mylist
print mylist[1]
# ---------- end python_14 ----------
python_15 = GhPythonScript()  # -> out
# ---------- python_15: Python ----------
__author__ = "J. Chung"
__version__ = "2022.03.19"

myGroup = ('Rhino', 'Grasshopper', 'Flamingo', 'Bongo')
print myGroup
# ---------- end python_15 ----------
python_16 = GhPythonScript()  # -> out
# ---------- python_16: Python ----------
__author__ = "J. Chung"
__version__ = "2022.03.19"

room_num = {'john': 425, 'tom': 212}
room_num['john'] = 645 
print (room_num['tom'])
room_num['isaac'] = 345 
print (room_num.keys()) 
print ('isaac' in room_num)
# ---------- end python_16 ----------
panel_9 = Panel(python_10)
panel_10 = Panel(python_11)
panel_11 = Panel(python_9)
panel_12 = Panel(python_12)
panel_13 = Panel(python_13)
panel_14 = Panel(python_14)
panel_15 = Panel(python_15)
panel_16 = Panel(python_16)
